# Grasshopper definition tower_Humpback.gh (Grasshopper 0.9.76)
# Copyright: Co-de-iT

balcony_glass = Brep([<brep referenced from the Rhino model> x98])
list_length = ListLength(List=balcony_glass)
awning = Brep([<brep referenced from the Rhino model> x4])
list_length_2 = ListLength(List=awning)
facade = Brep([<brep referenced from the Rhino model> x458])
list_length_3 = ListLength(List=facade)
slabs = Brep([<brep referenced from the Rhino model> x116])
list_length_4 = ListLength(List=slabs)
wall = Brep(<brep referenced from the Rhino model>)
list_length_5 = ListLength(List=wall)
roof = Brep(<brep referenced from the Rhino model>)
list_length_6 = ListLength(List=roof)
repeat_data = RepeatData(Data="Facade", Length=list_length_3)
repeat_data_2 = RepeatData(Data="Roof", Length=list_length_6)
repeat_data_3 = RepeatData(Data="Awning", Length=list_length_2)
repeat_data_4 = RepeatData(Data="Wall", Length=list_length_5)
repeat_data_5 = RepeatData(Data="Balcony Glass", Length=list_length)
repeat_data_6 = RepeatData(Data="Slabs", Length=list_length_4)
deextrusion = DeconstructExtrusion(brep=[slabs, balcony_glass, wall, roof, awning, facade])  # -> doc_2, G, H_2, bh_2
layer = Merge(
    Data1=repeat_data_6,
    Data2=repeat_data_5,
    Data3=repeat_data_4,
    Data4=repeat_data_2,
    Data5=repeat_data_3,
    Data6=repeat_data)
panel = Panel("151.104433, -33.918212")
repeat_data_7 = RepeatData(Data="#CD5C5C", Length=list_length_2)
repeat_data_8 = RepeatData(Data="#DAF7A6", Length=list_length_3)
repeat_data_9 = RepeatData(Data="#CD5C5C", Length=list_length_6)
repeat_data_10 = RepeatData(Data="#CD5C5C", Length=list_length_5)
layer_2 = Panel(layer)
repeat_data_11 = RepeatData(Data="#D6EAF8", Length=list_length)
base_height = Panel(deextrusion.bh_2)
height = Panel(deextrusion.H_2)
pt = Point(<point referenced from the Rhino model>)
crv = Curve(deextrusion.G)
repeat_data_12 = RepeatData(Data="#581845", Length=list_length_4)
colour = Merge(
    Data1=repeat_data_12,
    Data2=repeat_data_11,
    Data3=repeat_data_10,
    Data4=repeat_data_9,
    Data5=repeat_data_7,
    Data6=repeat_data_8)
colour_2 = Panel(colour)
orientne = OrientNE(G=crv, P=pt, N="-33.918212", E="151.104433")  # -> doc_2, G_3, pt_2
panel_2 = Panel("""height
base_height
colour
layer
tag""")
crv_2 = Curve(orientne.G_3)
repeat_data_13 = RepeatData(Data="Numbers go here 5", Length=list_length_2)
repeat_data_14 = RepeatData(Data="Numbers go here 6", Length=list_length_3)
repeat_data_15 = RepeatData(Data="Numbers go here 4", Length=list_length_6)
repeat_data_16 = RepeatData(Data="Numbers go here 3", Length=list_length_5)
repeat_data_17 = RepeatData(Data="Numbers go here 2", Length=list_length)
repeat_data_18 = RepeatData(Data="Numbers go here 1", Length=list_length_4)
tag = Merge(
    Data1=repeat_data_18,
    Data2=repeat_data_17,
    Data3=repeat_data_16,
    Data4=repeat_data_15,
    Data5=repeat_data_13,
    Data6=repeat_data_14)
tag_2 = Panel(tag)
entwine = Entwine(Branch00=height, Branch01=base_height, Branch02=colour_2, Branch03=layer_2, Branch04=tag_2, FlattenInputs=True)
polyjson = PolygonToGeoJSON(P=crv_2, K=panel_2, V=entwine)  # -> doc_2, J_2
file_write = FileWrite(
    content=polyjson.J_2,
    file_path="C:\Users\Madeleine\Documents\GitHub\PLAN2002\GeoJSON",
    T="tower_1.GeoJSON",
    activate=Toggle(False))

# ==== cluster DeconstructExtrusion: Deconstructs simple extrusions into polylines, heights, and base heights for later use in ‘Polygon to GeoJSON component’.
brep = ClusterInput()
brep_2 = Brep(simplify(graft(brep)))
cap = CapHoles(Brep=brep_2)
debrep = DeconstructBrep(Brep=cap)  # -> Faces, Edges, Vertices
debrep_2 = DeconstructBrep(Brep=cap)  # -> Faces, Edges, Vertices
area = MeshArea(Mesh=debrep_2.Faces)  # -> Area, Centroid
panel = Panel("Deconstructs simple extrusions into polylines, heights, and base heights for later use in ‘Polygon to GeoJSON component’.")
panel_2 = Panel(""" 
INPUTS: 

Brep (B) - Extruded or capped Breps. Must be extruded in the z axis. """)
pdecon = Deconstruct(Point=debrep.Vertices)  # -> XComponent, YComponent, ZComponent
panel_3 = Panel("""OUTPUTS:

Polyline (Crv)- Projected base polyline of Brep.

Height (H) - Height of Brep.The distance of extrusion. 

Base Height (BH) - The height of the base of the brep from the ground XY Plane.""")
pdecon_2 = Deconstruct(Point=area.Centroid)  # -> XComponent, YComponent, ZComponent
sort = SortList(Keys=pdecon_2.ZComponent, ValuesA=debrep_2.Faces)  # -> Keys, reverse(ValuesA)
sort_2 = SortList(Keys=simplify(pdecon.ZComponent))  # -> Keys, ValuesB
panel_4 = Panel("For more documentation visit: github.com/madeleinejohanson/Humpback")
item = ListItem(List=sort_2.Keys, Index=0, Wrap=True)  # -> Item1, Item
item_2 = ListItem(List=sort.ValuesA, Index=0, Wrap=True)
crv = Curve(item_2)
subtraction = Subtraction(A=item.Item1, B=item.Item)
project = Project(Geometry=crv, Plane=PlaneXY(0, 0, 0))  # -> Geometry, Transform
bh = Data(simplify(flatten(item.Item)))
H = Data(simplify(flatten(subtraction)))
merge = Merge(Data1="DECONSTRUCT EXTRUSION", Data2=panel, Data3=panel_2, Data4=panel_3, Data5=panel_4)
Z = UnitZ(Factor=bh)
move = Move(Geometry=flatten(project.Geometry), Motion=Z)  # -> Geometry, Transform
doc = Text(merge)
doc_2 = ClusterOutput(doc)
panel_5 = Panel(doc)

# ---- group: Cluster Output
H_2 = ClusterOutput(H)

# ----
bh_2 = ClusterOutput(bh)
G = ClusterOutput(move.Geometry)

# ==== cluster OrientNE: Orients geometry
panel = Panel("Orients geometry to specified Northing and Easting Coordinates")
panel_2 = Panel("""OUTPUTS:

Geometry (G) - Reoriented geometry

Point (Pt) - Coordinates represented as a point""")
panel_3 = Panel(""" 
INPUTS: 

Geometry (G) - Geometry to move.

Initial Plane (P) - Plane to move geometry from.

Northing (N) - Specified Northing coordinates as floating point 
eg. -33.857702

Easting(E) - Specified Easting coordinates as floating point 
eg. 151.203655""")
E = ClusterInput()
N = ClusterInput()
P = ClusterInput()
G = ClusterInput()
number_slider = Slider(100000, range=0..100000)
xy = XYPlane(Origin=Point(0, 0, 0))
E_2 = Number(E)
N_2 = Number(N)
G_2 = Geometry(G)
P_2 = Source(P)
panel_4 = Panel("For more documentation visit: github.com/madeleinejohanson/Humpback")
merge = Merge(Data1=P, Data2=xy)
multiplication = Multiplication(A=N_2, B=number_slider)
multiplication_2 = Multiplication(A=E_2, B=number_slider)
item = ListItem(List=merge, Index=0, Wrap=True)
pt = ConstructPoint(XCoordinate=multiplication_2, YCoordinate=multiplication, ZCoordinate=0)
orient = Orient(Geometry=G_2, Source=item, Target=pt)  # -> Geometry, Transform
G_3 = ClusterOutput(orient.Geometry)
pt_2 = ClusterOutput(pt)
merge_2 = Merge(Data1="ORIENT(N,E)", Data2=panel, Data3=panel_3, Data6=panel_2, Data7=panel_4)
doc = Text(merge_2)
doc_2 = ClusterOutput(doc)
panel_5 = Panel(doc)

# ==== cluster PolygonToGeoJSON: Writes a polygon to a GeoJSON file, where keys and values can be defined.
P = ClusterInput()
P_2 = Curve(P)
cp = ControlPoints(Curve=P_2)  # -> simplify(Points), Weights, Knots
V = ClusterInput()
K = ClusterInput()
V_2 = Data(simplify(V))
points_to_coordinates = PointsToCoordinates(P=cp.Points)
K_2 = Text(simplify(K))
clean = CleanTree(RemoveNulls=True, RemoveInvalid=True, RemoveEmpty=True, Tree=V_2)
viewer = ParamViewer(clean)
flip = FlipMatrix(Data=clean)
graft = GraftTree(Tree=K_2, IncludeEmptyLists=True, IncludeNullItems=True)  # -> simplify(Tree)
viewer_2 = ParamViewer(graft)
short = ShortestList(ListA=viewer_2, ListB=viewer, TrimMode=2)  # -> ListA, ListB
lng = ListLength(List=flatten(short.ListB))
series = Series(Start=0, Step=1, Count=lng)
item = ListItem(List=viewer_2, Index=series, Wrap=False)
flip_2 = FlipMatrix(Data=flip)
branch = TreeBranch(Tree=graft, Path=item, MaintainPaths=True)
clean_2 = CleanTree(RemoveNulls=True, RemoveInvalid=True, RemoveEmpty=True, Tree=branch)
flatten = FlattenTree(Tree=clean_2, Path="{0}")
rep = ReplaceText(Text="\"█\"", Find="█", Replace=flatten, RecursiveReplace=False)  # -> flatten(Result)
series_2 = Series(Start=0, Step=1, Count=lng)
mindex = MemberIndex(Set=rep, Member="\"height\"")  # -> Index, Count
rep_2 = ReplaceText(Text="{ \"type\": \"Polygon\",█}", Find="█", Replace=points_to_coordinates, RecursiveReplace=False)

# ---- group: Polygon
flatten_2 = FlattenTree(Tree=rep_2, Path="{0}")

# ----
mindex_2 = MemberIndex(Set=rep, Member="\"base_height\"")  # -> Index, Count
panel = Panel("Writes a polygon to a GeoJSON file, where keys and values can be defined. ")
panel_2 = Panel("""OUTPUTS:

GeoJSON (J) - Produces a GeoJSON Feature Collection.""")
panel_3 = Panel(""" 
INPUTS: 

Polyline Curve (P) - Polygon or list of polygons to convert to GeoJSON.

Key (K)- Properties used to describe geometry. To specify height, base height and colour, use the following keys: 

height
base_height
colour 

Value (V) - Values of properties. The list should be structured so that the first branch of data is associated with the first key. This allows unique values to be associated with multiple polygons. """)
panel_4 = Panel("For more documentation visit: github.com/madeleinejohanson/Humpback")
rep_3 = ReplaceText(Text="{\"type\":\"Feature\",\"geometry\":█", Find="█", Replace=flatten_2, RecursiveReplace=False)
merge = Merge(Data1="POLYGON TO GEOJSON", Data2=panel, Data3=panel_3, Data6=panel_2, Data7=panel_4)
doc = Text(merge)
doc_2 = ClusterOutput(doc)
panel_5 = Panel(doc)

# ---- group: Keeps lists consistent lengths, repeating the last value for the total amount of keys
null = NullItem(Item=flip)  # -> NullFlags, InvalidFlags, Description
dispatch = Dispatch(List=flip, DispatchPattern=null.NullFlags)  # -> ListA, ListB
nullrep = ReplaceNulls(Items=flip, Replacements="█")  # -> Items, Count
index = ItemIndex(List=dispatch.ListB, Item=dispatch.ListB)
item_2 = ListItem(List=flip, Index=index, Wrap=True)
mindex_3 = MemberIndex(Set=nullrep.Items, Member="█")  # -> Index, Count
flip_3 = FlipMatrix(Data=item_2)
clean_3 = CleanTree(RemoveNulls=True, RemoveInvalid=True, RemoveEmpty=False, Tree=flip_3)
item_3 = ListItem(List=clean_3, Index=0, Wrap=True)  # -> flatten(Item1), Item

# ----
merge_2 = Merge(Data1=flip_3, Data2=flip_2)
clean_4 = CleanTree(RemoveNulls=True, RemoveInvalid=True, RemoveEmpty=False, Tree=merge_2)
item_4 = ListItem(List=clean_4, Index=0, Wrap=True)  # -> flatten(Item1), Item

# ---- group: Keeps lists consistent lengths, repeating the last value for the total amount of keys (continued)
item_5 = ListItem(List=item_4.Item1, Index=mindex_3.Index, Wrap=True)
replace = ReplaceItems(List=nullrep.Items, Item=item_5, Indices=mindex_3.Index, Wrap=False)

# ----
flip_4 = FlipMatrix(Data=replace)
viewer_3 = ParamViewer(flip_4)
item_6 = ListItem(List=viewer_3, Index=series_2, Wrap=True)

# ---- group: Keeps lists consistent lengths, repeating the last value for the total amount of keys (continued)
branch_2 = TreeBranch(Tree=flip_4, Path=item_6, MaintainPaths=True)  # -> simplify(Branch)

# ----
flip_5 = FlipMatrix(Data=branch_2)

# ---- group: height
item_7 = ListItem(List=flip_5, Index=mindex.Index, Wrap=True)

# ---- group: base_height
item_8 = ListItem(List=flip_5, Index=mindex_2.Index, Wrap=True)

# ----
panel_6 = Panel(flip_5)
addition = Addition(A=item_7, B=item_8)
replace_2 = ReplaceItems(List=simplify(flip_5), Item=addition, Indices=mindex.Index, Wrap=False)  # -> simplify(List)
clean_5 = CleanTree(RemoveNulls=True, RemoveInvalid=True, RemoveEmpty=True, Tree=replace_2)
key_value = KeyValue(K=clean_2, V=clean_5)
rep_4 = ReplaceText(Text=",\"properties\":█}", Find="█", Replace=key_value, RecursiveReplace=False)

# ---- group: Feature
concat = Concatenate(FragmentA=rep_3, FragmentB=rep_4)  # -> flatten(Result)

# ----
join = TextJoin(Text=concat, Join=",")
panel_7 = Panel(key_value)
rep_5 = ReplaceText(Text="{\"type\":\"FeatureCollection\",\"features\":[█]}", Find="█", Replace=join, RecursiveReplace=False)
J = Text(rep_5)
J_2 = ClusterOutput(J)

# ==== cluster FileWrite: Exports text to file
content = ClusterInput()
file_path = ClusterInput()
activate = ClusterInput()
T = ClusterInput()
content_2 = Data(content)
file_path_2 = Text(file_path)
join = TextJoin(Text=[file_path_2, T], Join="\")
vb = VBScript(path=simplify(join), lines=simplify(content_2), activate=activate)  # -> out, A
# ---------- vb: VB ----------
    If (activate = True)
      
      system.IO.File.WriteAllText(path, lines)
      A = "File written"
    Else
      A = "Not activated"
    End If
# ---------- end vb ----------

# ==== cluster PointsToCoordinates
P = ClusterInput()
pt2num = PointsToNumbers(Points=graft(P), Mask=4)
division = Division(A=pt2num, B=Slider(100000, range=0..100000))
expression = Expression(x=division, Expression="format(\"{0}\",x)")
item = ListItem(List=expression, Index=0, Wrap=True)  # -> Item, Item1, Item2
num = Number(item.Item2)  # disabled
merge = Merge(Data1=item.Item, Data2=item.Item1, Data3=num)
wrapper = Wrapper(wrap="[", content=merge, join=",")  # -> simplify(wrapped)
utrim = UberTrim(data=wrapper, bool=Toggle(True))
wrapper_2 = Wrapper(wrap="[", content=utrim, join=",")
rep = ReplaceText(Text="\"coordinates\": [█]", Find="█", Replace=wrapper_2, RecursiveReplace=False)  # -> simplify(Result)
R = ClusterOutput(rep)

# ==== cluster KeyValue
K = ClusterInput()
V = ClusterInput()
K_2 = Text(simplify(K))
V_2 = Data(simplify(V))
rep = ReplaceText(Text="\"█\"", Find="█", Replace=K_2, RecursiveReplace=False)  # -> simplify(Result)
rep_2 = ReplaceText(Text="\"█\"", Find="█", Replace=V_2, RecursiveReplace=False)
flip = FlipMatrix(Data=rep_2)  # -> simplify(Data)
lng = ListLength(List=flatten(rep))
viewer = ParamViewer(flip)
series = Series(Start=0, Step=1, Count=lng)
item = ListItem(List=viewer, Index=series, Wrap=True)
branch = TreeBranch(Tree=simplify(flip), Path=simplify(item), MaintainPaths=True)
long = LongestList(ListA=rep, ListB=branch, PaddingMode=2)  # -> ListA, ListB
merge = Merge(Data1=graft(long.ListA), Data2=graft(long.ListB))
join = TextJoin(Text=merge, Join=":")
trim = TrimTree(Tree=join, Depth=1)
flip_2 = FlipMatrix(Data=trim)
join_2 = TextJoin(Text=flip_2, Join=",")
rep_3 = ReplaceText(Text="{█}", Find="█", Replace=join_2, RecursiveReplace=False)  # -> flatten(Result)
J = Text(rep_3)
J_2 = ClusterOutput(J)

# ==== cluster UberTrim: Better version of Trim
data = ClusterInput()
bool = ClusterInput()
data_2 = Data(data)
trim = TrimTree(Tree=data_2, Depth=1)
null = NullItem(Item=trim)  # -> NullFlags, InvalidFlags, Description
dispatch = Dispatch(List=data_2, DispatchPattern=null.NullFlags)  # -> ListA, ListB
bool_2 = Boolean(bool)
trim_2 = TrimTree(Tree=dispatch.ListB, Depth=1)
flatten = FlattenTree(Tree=dispatch.ListA, Path="{0}")
bool_3 = Boolean(invert(null.NullFlags))
merge = Merge(Data1=flatten, Data2=trim_2)
panel = Panel(null.NullFlags)
trim_3 = TrimTree(Tree=data_2, Depth=bool_3)
bool_4 = Boolean(invert(bool_2))
data_3 = Data(trim_3)
dispatch_2 = Dispatch(List=merge, DispatchPattern=bool_4)  # -> ListA, ListB
dispatch_3 = Dispatch(List=data_3, DispatchPattern=bool_2)  # -> ListA, ListB
clean = CleanTree(RemoveNulls=True, RemoveInvalid=True, RemoveEmpty=True, Tree=dispatch_3.ListB)
clean_2 = CleanTree(RemoveNulls=True, RemoveInvalid=True, RemoveEmpty=True, Tree=dispatch_2.ListB)
merge_2 = Merge(Data1=clean, Data2=clean_2)
R = ClusterOutput(merge_2)
panel_2 = Panel(merge_2)

# ==== cluster Wrapper: Wraps data with a wrapping character
join = ClusterInput()  # Join character
content = ClusterInput()  # Content to be wrapped
wrap = ClusterInput()  # Wrap character or XML tag
txt = Text(join)
null = NullItem(Item=txt)  # -> NullFlags, InvalidFlags, Description
data = Data(content)
tmatch = MatchText(Text=wrap, RegEx="<*.>", Case=True)
bool = Boolean(null.NullFlags)
dispatch = Dispatch(List=data, DispatchPattern=bool)  # -> ListA, ListB
item = ListItem(List=wrap, Index=0, Wrap=True)
split = TextSplit(Text=item, Separators=" ")
join_2 = TextJoin(Text=dispatch.ListB, Join=txt)
panel = Panel("""{
[
(
"
'""")
panel_2 = Panel("""{█}
[█]
(█)
"█"
'█'""")
item_2 = ListItem(List=split, Index=0, Wrap=True)
weave = Weave(Pattern=bool, Stream0=join_2, Stream1=dispatch.ListA, NullGaps=False)
data_2 = Data(wrap)
replace = ReplaceMembers(Set=data_2, Find=panel, Replace=panel_2)
rep = ReplaceText(Text=item_2, Find="<", Replace="</", RecursiveReplace=False)
expression = Expression(x=item, y=rep, Expression="Format(\"{0}█{1}>\", x, y)")
rep_2 = ReplaceText(Text=expression, Find=">>", Replace=">", RecursiveReplace=False)
weave_2 = Weave(Pattern=tmatch, Stream0=replace, Stream1=rep_2, NullGaps=False)
rep_3 = ReplaceText(Text=weave_2, Find="█", Replace=weave, RecursiveReplace=False)
data_3 = Data(rep_3)
wrapped = ClusterOutput(data_3)  # Wrapped Output
